# Grasshopper definition translation.gh (Grasshopper 0.9.76)
# plug-ins: Python Interpreter

profile = Curve(<curve referenced from the Rhino model>)
rail_1 = Curve(<curve referenced from the Rhino model>)
rail_2 = Curve(<curve referenced from the Rhino model>)
python = PythonScript(crv_p=profile, crv_a=rail_1, crv_b=rail_2, div_p=Slider(18, range=0..100), div_r=Slider(40, range=0..100))  # -> out, polys; inputs crv_p: Curve, crv_a: Curve, crv_b: Curve, div_p: Int32, div_r: Int32
# ---------- python: Python ----------
import Rhino as rc
import rhinoscriptsyntax as rs

from compas.geometry import subtract_vectors
from compas.geometry import add_vectors
from compas.geometry import normalize_vector
from compas.geometry import centroid_points
from compas.geometry import intersection_line_plane
from compas.geometry import intersection_line_line
    
    
# divide profile and rail curves
pts_p = rs.DivideCurve(crv_p, div_p)
pts_a = rs.DivideCurve(crv_a, div_r)
pts_b = rs.DivideCurve(crv_b, div_r)

# ------------------------------
# compas geometry function

# create planes along the rail curve
planes = []
for i in range(div_r):
    pt_mid = centroid_points([pts_a[i], pts_b[i]])
    vec_a = subtract_vectors(pts_a[i + 1], pts_a[i])
    vec_b = subtract_vectors(pts_b[i + 1], pts_b[i])
    vec_a = normalize_vector(vec_a)
    vec_b = normalize_vector(vec_b)
    vec = add_vectors(vec_a, vec_b)
    planes.append([pt_mid, vec])

# create profiles
pts_uv = []
pts = pts_p
for i in range(div_r - 1):
    ray_a = [pts_a[i], pts_a[i + 1]]
    ray_b = [pts_b[i], pts_b[i + 1]]
    pts_x = intersection_line_line(ray_a, ray_b)
    if None in pts_x:
        print("parallel!")
    pt_cent = centroid_points(pts_x)
    # computes intersection between a plane and all lines
    # from the profile curve points to the intersection point
    pts = [intersection_line_plane([pt, pt_cent], planes[i + 1]) for pt in pts]
    
    pts_uv.append(pts)

# create polyline point sets for each face
polys = []
for u in xrange(len(pts_uv)-1):
    for v in xrange(len(pts_uv[u])-1):
        p1 = pts_uv[u][v] 
        p2 = pts_uv[u + 1][v] 
        p3 = pts_uv[u + 1][v + 1] 
        p4 = pts_uv[u][v + 1]
        polys.append(rc.Geometry.Polyline(rs.coerce3dpointlist([p1, p2, p3, p4, p1])))
# ---------- end python ----------
panel = Panel(python.out)
